# Grasshopper definition ws_1.gh (Grasshopper 1.0.8)
# plug-ins: RhinoCodePluginGH

# with received message
panel = Panel("hello")
# connect websocket
panel_2 = Panel("hello")
cs = CSharpScript()  # -> out, A; inputs msg: String
# ---------- cs: C# ----------
using System;
using System.Collections;
using System.Collections.Generic;
using System.Drawing;

using Rhino;
using Rhino.Geometry;

using Grasshopper;
using Grasshopper.Kernel;
using Grasshopper.Kernel.Data;
using Grasshopper.Kernel.Types;

using System.Net.WebSockets;
using System.Text;
using System.Threading;
using System.Threading.Tasks;

public class Script_Instance : GH_ScriptInstance
{
    public async Task SendMessageAsync(string uri, string message)
    {
        using (var ws = new ClientWebSocket())
        {
            await ws.ConnectAsync(new Uri(uri), CancellationToken.None);

            // メッセージを送信
            byte[] buffer = Encoding.UTF8.GetBytes(message);
            await ws.SendAsync(new ArraySegment<byte>(buffer), WebSocketMessageType.Text, true, CancellationToken.None);

            // WebSocket を閉じる
            await ws.CloseAsync(WebSocketCloseStatus.NormalClosure, "", CancellationToken.None);
        }
    }

    // Grasshopper C# スクリプトの RunScript メソッド内
    private void RunScript(string msg, ref object A)
    {
        // WebSocket 通信を行う非同期メソッドを実行し、その結果を待つ
        Task.Run(async () => {
            await SendMessageAsync("ws://127.0.0.1:5000", msg);
        });

        A = "Message sent: " + msg;
    }
}
# ---------- end cs ----------
cs_2 = CSharpScript()  # -> out, A; inputs msg: String
# ---------- cs_2: C# ----------
using System;
using System.Collections;
using System.Collections.Generic;
using System.Drawing;

using Rhino;
using Rhino.Geometry;

using Grasshopper;
using Grasshopper.Kernel;
using Grasshopper.Kernel.Data;
using Grasshopper.Kernel.Types;

using System.Net.WebSockets;
using System.Text;
using System.Threading;
using System.Threading.Tasks;

public class Script_Instance : GH_ScriptInstance
{
public async Task<string> SendReceiveAsync(string uri, string message)
{
    using (var ws = new ClientWebSocket())
    {
        await ws.ConnectAsync(new Uri(uri), CancellationToken.None);

        // メッセージを送信
        byte[] buffer = Encoding.UTF8.GetBytes(message);
        await ws.SendAsync(new ArraySegment<byte>(buffer), WebSocketMessageType.Text, true, CancellationToken.None);

        // メッセージを受信
        buffer = new byte[1024];
        var result = await ws.ReceiveAsync(new ArraySegment<byte>(buffer), CancellationToken.None);
        var receivedMessage = Encoding.UTF8.GetString(buffer, 0, result.Count);

        // WebSocket を閉じる
        await ws.CloseAsync(WebSocketCloseStatus.NormalClosure, "", CancellationToken.None);

        return receivedMessage;
    }
}

private void RunScript(string msg, ref object A)
{
      var receivedMessage = ""; // 受信メッセージを保存するための変数
    // WebSocket 通信を行う非同期メソッドを実行し、その結果を待つ
    var task = Task.Run(async () => {
        return await SendReceiveAsync("ws://127.0.0.1:5000", msg);
        
    });
    receivedMessage = task.Result; // 非同期処理の結果を取得

    A = receivedMessage; // 受信したメッセージを出力パラメータに設定
}
}
# ---------- end cs_2 ----------
