# Grasshopper definition ws_gh2.gh (Grasshopper 1.0.8)
# plug-ins: RhinoCodePluginGH

cs = CSharpScript(go=Button())  # -> out, A; inputs go: Boolean
# ---------- cs: C# ----------
using System;
using System.Collections;
using System.Collections.Generic;
using System.Drawing;

using Rhino;
using Rhino.Geometry;

using Grasshopper;
using Grasshopper.Kernel;
using Grasshopper.Kernel.Data;
using Grasshopper.Kernel.Types;

using System.Net.WebSockets;
using System.Text;
using System.Threading;
using System.Threading.Tasks;

public class Script_Instance : GH_ScriptInstance
{
    private ClientWebSocket ws = new ClientWebSocket();
    private string receivedMessage = "";

    // WebSocket 通信を行う非同期メソッド
    private async Task StartWebSocketAsync(string uri)
    {
        if (ws.State != WebSocketState.Open)
        {
            await ws.ConnectAsync(new Uri(uri), CancellationToken.None);
            await StartReceiving();
        }
    }

    // 非同期でメッセージを受信するメソッド
    private async Task StartReceiving()
    {
        var buffer = new byte[1024];
        while (ws.State == WebSocketState.Open)
        {
            var result = await ws.ReceiveAsync(new ArraySegment<byte>(buffer), CancellationToken.None);
            if (result.MessageType == WebSocketMessageType.Close)
            {
                await ws.CloseAsync(WebSocketCloseStatus.NormalClosure, string.Empty, CancellationToken.None);
            }
            else
            {
                receivedMessage = Encoding.UTF8.GetString(buffer, 0, result.Count);
            }
        }
    }

    // RunScript メソッド内
    private void RunScript(bool go, ref object A)
    {
        if (go)
        {
            Task.Run(async () => {
                await StartWebSocketAsync("ws://127.0.0.1:5000");
                Rhino.RhinoApp.WriteLine("WebSocket Connected");
            });
        }

        A = receivedMessage;
    }
}
# ---------- end cs ----------
panel = Panel(cs.A)
